% Simulink data dictionary CarDict.sldd

rollingRadius = Simulink.Parameter(0.3, Unit="m")  % Wheel rolling radius.
clutchVeloTolRads = Simulink.Parameter(0.001, Unit="rad/s")  % The clutch can lock when the wheel speed is below this threshold.

clutchPressureTresh = Simulink.Parameter(1, DataType="double", Min=0, Max=10000, Unit="Pa")  % The clutch pressure threshold. The level of pressure required for the brake clutch to
  % be applied.

numSurf = Simulink.Parameter(1)  % The number of friction surfaces in the brake clutch.
axleInertia = Simulink.Parameter(1, Unit="kg*m^2")  % The inertia of an individual wheel axis (i.e. from wheel to differential).
pistonArea = Simulink.Parameter(0.01, Unit="m^2")

hydraulicDelay = Simulink.Parameter(0.001, Unit="s")  % Simulated hydraulic delay in the brake cylinder.
  % This is mostly in place to prevent algebraic loops (since the ABS S-function is configured
  % as direct-feedthrough).

clutchKineticF = Simulink.Parameter(0.31)  % Brake clutch kinetic friction coefficient.
clutchStaticF = Simulink.Parameter(0.35)  % Brake clutch static friction coefficient.
torqueRadius = Simulink.Parameter(300, Unit="mm")

pressureGain = Simulink.Parameter(1800000, Min=100, Unit="Pa")  % Pressure gain parameter in the brake cylinder model. Pressure is scaled in the range
  % [0,pressureGain].

engineRPM = Simulink.Parameter(1000, Unit="rpm")
initialVelocity = Simulink.Parameter(25, Unit="m/s")  % The initial velocity of the vehicle in m/s.